# Grasshopper definition exampleDesignConfig.ghx (Grasshopper 1.0.7)
# plug-ins: eleFront, Speckle 2, Components

# ---- group: FFL Zs
number_slider = Slider(0, range=0..100)
series = Series(Start=0, Step=Slider(3.1, range=0..10), Count=Slider(20, range=0..100))
merge = Merge(Data1=Slider(6.2, range=0..10), Data2=Slider(3.1, range=0..10))
addition = Addition(A=series, B=Slider(5, range=0..10))
neg = Negative(Value=merge)
ins = InsertItems(List=addition, Item=number_slider, Indices=number_slider, Wrap=True)
ins_2 = InsertItems(List=ins, Item=neg, Indices=number_slider, Wrap=True)
addition_2 = Addition(A=ins_2, B=Slider(0.3, range=0..1))

# ----
reflay = ReferenceByLayer(LayerName="complex::*", lightweight=False)

pt = ConstructPoint(XCoordinate=0, YCoordinate=0, ZCoordinate=addition_2)
xy = XYPlane(Origin=pt)
contour = ContourEx(Shape=simplify(graft(reflay)), Plane=xy, Distances=Slider(0, range=0..100))
data = Data(simplify(graft(reflay)))
clean = CleanTree(RemoveNulls=True, RemoveInvalid=True, RemoveEmpty=True, Tree=contour)
path_mapper = PathMapper(clean, source="{A;B;C;D;E}", target="{C}")
edges = BrepEdges(Brep=data)  # -> Naked, Interior, NonManifold
pshift = ShiftPaths(Data=edges.Interior, Offset=-1)
boundary = BoundarySurfaces(Edges=path_mapper)
merge_2 = Merge(Data1=data, Data2=pshift)
panel = Panel(data)
graft = GraftTree(Tree=boundary, IncludeEmptyLists=True, IncludeNullItems=True)
getuv = GetUserValue(Geometry=data, Key="type")  # -> simplify(Values)
cso = CreateSpeckleObject(DisplayValue=merge_2, selectedKitName="Objects")
rhatt = GetRhinoAttributes(Geometry=data, fullpath=False)  # -> Name, Layer, Color, MaterialName, SourceFile
area = Area(Geometry=graft)  # -> Area, Centroid
pdecon = Deconstruct(Point=area.Centroid)  # -> XComponent, YComponent, ZComponent
split = TextSplit(Text=rhatt.Layer, Separators=" ")
txt = Text(flatten(pdecon.ZComponent))
item = ListItem(List=split, Index=0, Wrap=True)  # -> Item1, Item
tmatch = MatchText(Text=graft(txt), Pattern=addition_2, Case=True)
split_2 = TextSplit(Text=item.Item1, Separators="::")
mindex = MemberIndex(Set=tmatch, Member=Toggle(True))  # -> flatten(Index), Count
item_2 = ListItem(List=simplify(split_2), Index=0, Wrap=True)  # -> Item1, Item, Item1_2, Item2
unflatten = UnflattenTree(Tree=mindex.Index, Guide=pdecon.ZComponent)
subtraction = Subtraction(A=unflatten, B=Slider(2, range=0..10))
case = TextCase(Text="Floor", Culture=127)  # -> UpperCase, LowerCase
crossref = CrossReference(ListA="Floor", ListB=subtraction, CrossMode=1)  # -> ListA, ListB
merge_3 = Merge(Data1=item_2.Item2, Data2=item_2.Item1)
merge_4 = Merge(Data1=graft(crossref.ListA), Data2=graft(crossref.ListB))
join = TextJoin(Text=merge_3)  # -> simplify(Result)
edges_2 = BrepEdges(Brep=graft)  # -> Naked, Interior, NonManifold
join_2 = TextJoin(Text=merge_4)
pshift_2 = ShiftPaths(Data=edges_2.Naked, Offset=-1)  # disabled
pshift_3 = ShiftPaths(Data=join_2, Offset=-1)
merge_5 = Merge(Data1=graft, Data2=pshift_2)
crossref_2 = CrossReference(ListA=join, ListB=pshift_3, CrossMode=1)  # -> ListA, ListB
panel_2 = Panel(rhatt.Color)
merge_6 = Merge(Data1=graft(crossref_2.ListA), Data2=graft(crossref_2.ListB))
cso_2 = CreateSpeckleObject(DisplayValue=merge_5, selectedKitName="Objects")
join_3 = TextJoin(Text=merge_6)
dso = DeconstructSpeckleObject(selectedKitName="Objects")
pshift_4 = ShiftPaths(Data=join_3, Offset=-1)
sso = RenderMaterial(
    Opacity=Slider(1, range=0..1),
    Metalness=Slider(0.5, range=0..1),
    Roughness=1,
    Diffuse=rhatt.Color,
    Emissive=rhatt.Color,
    SelectedConstructorName="Objects.Other.RenderMaterial.ctor(System.Double,System.Double,System.Double,System.Nullable`1[System.Drawing.Color],System.Nullable`1[System.Drawing.Color])",
    SelectedTypeName="Objects.Other.RenderMaterial",
    UseSchemaTag=False,
    UserSetSchemaTag=False,
    seed="c71a79b1a0588b06e21e")
srl = Serialize()
crke = CreateRangekeeperEntity(SpeckleObject=cso)
crke_2 = CreateRangekeeperEntity(SpeckleObject=cso_2)
crossref_3 = CrossReference(ListA=rhatt.Color, ListB=crke_2, CrossMode=1)  # -> ListA, ListB
eso = ExtendSpeckleObject(SpeckleObject=crke, Name=join, Type=getuv, RenderMaterial=sso, selectedKitName="Objects")
sso_2 = RenderMaterial(
    Opacity=Slider(1, range=0..1),
    Metalness=0,
    Roughness=1,
    Diffuse=crossref_3.ListA,
    Emissive=crossref_3.ListA,
    SelectedConstructorName="Objects.Other.RenderMaterial.ctor(System.Double,System.Double,System.Double,System.Nullable`1[System.Drawing.Color],System.Nullable`1[System.Drawing.Color])",
    SelectedTypeName="Objects.Other.RenderMaterial",
    UseSchemaTag=False,
    UserSetSchemaTag=False,
    seed="fdb7e44b0970af453b79")
eso_2 = ExtendSpeckleObject(
    SpeckleObject=crke_2,
    Name=pshift_4,
    Type=case.LowerCase,
    FloorFFL=pdecon.ZComponent,
    FloorGFA=area.Area,
    FloorNum=subtraction,
    RenderMaterial=sso_2,
    selectedKitName="Objects")
pshift_5 = ShiftPaths(Data=eso_2, Offset=-1)
crossref_4 = CrossReference(ListA=eso, ListB=pshift_5, CrossMode=1)  # -> ListA, ListB
crka = CreateRangekeeperAssembly(SourceEntities=crossref_4.ListA, TargetEntities=crossref_4.ListB, RelationshipTypes="contains")
dso_2 = DeconstructSpeckleObject(SpeckleObject=pshift_5, selectedKitName="Objects")  # -> DisplayValue, EntityId, FloorFFL, FloorGFA, FloorNum, Name, RenderMaterial, Type
cset = CreateSet(List=flatten(item_2.Item2))  # -> Set, Map
eso_3 = ExtendSpeckleObject(SpeckleObject=crka, Name=join, Type="compartment", selectedKitName="Objects")
dso_3 = DeconstructSpeckleObject(SpeckleObject=eso_3, selectedKitName="Objects")  # -> Entities, EntityId, Name, Relationships, Type
tmatch_2 = MatchText(Text=dso_3.Name, RegEx=cset.Set, Case=True)  # -> simplify(Match)
flip = FlipMatrix(Data=tmatch_2)
cso_3 = CreateSpeckleObject(Name=cset.Set, Type="building", selectedKitName="Objects")
crke_3 = CreateRangekeeperEntity(SpeckleObject=cso_3)
sift = SiftPattern(List=flatten(eso_3), SiftPattern=flip)  # -> Output0, Output1
clean_2 = CleanTree(RemoveNulls=True, RemoveInvalid=True, RemoveEmpty=False, Tree=sift.Output1)
cso_4 = CreateSpeckleObject(Name="development", Type="development", selectedKitName="Objects")
crossref_5 = CrossReference(ListA=simplify(graft(crke_3)), ListB=clean_2, CrossMode=1)  # -> ListA, ListB
crke_4 = CreateRangekeeperEntity(SpeckleObject=cso_4)

list = Accounts(
    {"No account selected": , "Account (danfink@mit.edu | https://speckle.xyz)": "3865a09189"}, selected="Account (danfink@mit.edu | https://speckle.xyz)",
    selectedId="3865a09189",
    selectedServer="https://speckle.xyz")
screate = CreateStream(SpeckleAccount=list, stream="f5e306e3fa https://speckle.xyz 3865a09189")
sup = StreamUpdate(Stream=screate, Name="RangekeeperDemo", Public=True)

crka_2 = CreateRangekeeperAssembly(SourceEntities=crossref_5.ListA, TargetEntities=crossref_5.ListB, RelationshipTypes="contains")
crossref_6 = CrossReference(ListA=simplify(graft(crke_4)), ListB=crka_2, CrossMode=1)  # -> flatten(ListA), flatten(ListB)
crka_3 = CreateRangekeeperAssembly(SourceEntities=crossref_6.ListA, TargetEntities=crossref_6.ListB, RelationshipTypes="contains")
toggle = BooleanToggle(False)
send = Send(
    Stream=screate,
    Data=crka_3,
    AutoSend=False,
    BaseId="eae8feebd2376fef6e0610906d3fab3c",
    CurrentComponentState="up_to_date",
    KitName="Objects",
    OutputWrappers="https://speckle.xyz\tf5e306e3fa\t57bb734aa4",
    UseDefaultCache=True,
    selectedKitName="Objects")
panel_3 = Panel(send)
